% Simulink data dictionary apDataDictionary.sldd

apTransNavBus = Simulink.Bus()
  lat_deg_d: double  % 纬度
  lon_deg_d: double  % 经度
  lonlatValid_b: boolean  % 经纬度有效
  alt_m_f: single  % 高度
  altValid_b: boolean  % 高度有效
  velN_mps_f: single  % 北向地速
  velE_mps_f: single  % 东向地速
  velNEValid_b: boolean  % 水平速度有效
  velU_mps_f: single  % 垂向速度
  velUValid_b: boolean  % 垂向速度有效
  accN_mps2_f: single  % 北向加速度
  accE_mps2_f: single  % 东向加速度
  accU_mps2_f: single  % 向上加速度
  roll_deg_f: single  % 滚转角
  pitch_deg_f: single  % 俯仰角
  attValid_b: boolean  % 姿态有效
  yaw_deg_f: single  % 偏航角
  yawValid_b: boolean  % 偏航角有效
  p_dps_f: single  % 滚转角速度
  q_dps_f: single  % 俯仰角速度
  r_dps_f: single  % 偏航角速度
  hag_m_f: single  % 离地高度
  hagValid_b: boolean  % 离地高度有效
  vg_mps_f: single  % 地速
  vgValid_b: boolean  % 地速有效
  tas_mps_f: single  % 空速
  tasValid_b: boolean  % 空速有效

APCMD_TYPE = enum(DefaultValue="AP_CMD_NORMAL")
  AP_CMD_NORMAL = 0  % 正常模式
  AP_CMD_ATT = 1  % 旋翼定姿模式

apCmdBus = Simulink.Bus()
  vxCmd_mps_f: single  % 前向速度指令
  vyCmd_mps_f: single  % 侧向速度指令
  vuCmd_mps_f: single  % 垂向速度指令
  rollCmd_deg_f: single  % 滚转角指令
  pitchCmd_deg_f: single  % 俯仰角指令
  yawCmd_deg_f: single  % 偏航角指令
  tiltEnable_b: boolean  % 倾转使能标志
  apRunState_b: boolean  % ap运行状态
  apCmdType_u8: Enum: APCMD_TYPE  % ap指令类型

MSSN_TYPE = enum(DefaultValue="IDLE")
  IDLE = 0  % 空闲
  ROUTE_FLIGHT = 1  % 航线飞行
  RTH = 2  % 返航
  VERTICAL_TAKEOFF = 3  % 垂直起飞
  AUTO_FORWARD_TILT = 4  % 自动前倾
  AUTO_BACKWARD_TILT = 5  % 自动后倾
  AUTO_LAND_POINT_LOITER = 6  % 定点盘旋
  AUTO_LAND_DIRECTION_BACK_TILT = 7  % 定向后倾
  AUTO_LAND_POINT_LAND = 8  % 定点着陆
  ATT_LAND_ALTITUDE_LOITER = 9  % 定高盘旋
  ATT_LAND_ATTITUDE_BACK_TILT = 10  % 定姿后倾
  ATT_LAND_ATTITUDE_LAND = 11  % 定姿着陆

FLIGHT_PHASE = enum(DefaultValue="INVALID")
  INVALID = 0  % 无效（AP仅处理旋翼地面、旋翼飞行、倾转飞行和固定翼飞行阶段）
  MC_GROUND = 1  % 旋翼地面阶段
  MC_FLIGHT = 2  % 旋翼飞行阶段
  TILT_FLIGHT = 3  % 倾转飞行阶段
  FW_FLIGHT = 4  % 固定翼飞行阶段

AP_TASK_INTENT = enum(DefaultValue="IDLE")
  IDLE = 0  % 空闲
  ROUTE_FLIGHT = 1  % 航线飞行
  RTH = 2  % 返航
  VERTICAL_TAKEOFF = 3  % 垂直起飞
  AUTO_FORWARD_TILT = 4  % 自动前倾
  AUTO_BACKWARD_TILT = 5  % 自动后倾
  AUTO_LAND = 6  % 自动着陆
  ATT_EMERGENCY_LAND = 7  % 定姿迫降

faultCaseBus = Simulink.Bus()
  pilotCtrlSigLoss_b: boolean  % 操纵信号有效性

AP_TASK_CMD = enum(DefaultValue="INVALID_CMD")
  INVALID_CMD = 0  % 无效
  ROUTE_FLIGHT_CMD = 1  % 航线飞行指令
  RTH_CMD = 2  % 返航指令
  VERTICAL_TAKEOFF_CMD = 3  % 垂直起飞指令
  AUTO_FORWARD_TILT_CMD = 4  % 自动前倾指令
  AUTO_BACKWARD_TILT_CMD = 5  % 自动后倾指令
  AUTO_LAND_CMD = 6  % 自动着陆指令
  AP_DISCONNECT_CMD = 7  % AP断开指令

wayPointBus = Simulink.Bus()
  wpType_u8: Enum: WP_TYPE  % 航点类型
  lat_deg_d: double  % 纬度
  lon_deg_d: double  % 经度
  alt_m_f: single  % 高度
  spd_mps_f: single  % 速度
  radius_m_f: single  % 圆弧半径
  fastWp_b: boolean  % 快速过点标志
  yawType_u8: uint8  % 偏航角类型
  yaw_deg_f: single  % 指定偏航角
  timeOrCount_u16: uint16  % 时间或圈数
  arrivalCond_u8: uint8  % 圆弧点到达判定条件

localNEUWpBus = Simulink.Bus()
  wpType_u8: Enum: WP_TYPE  % 航点类型
  posN_m_f: single  % N位置
  posE_m_f: single  % E位置
  posU_m_f: single  % U高度
  spd_mps_f: single  % 速度
  radius_m_f: single  % 圆弧半径
  fastWp_b: boolean  % 快速过点标志
  yawType_u8: uint8  % 偏航角类型
  yaw_deg_f: single  % 指定偏航角
  timeOrCount_u16: uint16  % 时间或圈数
  arrivalCond_u8: uint8  % 圆弧点到达判定条件

missionRoutePlanBus = Simulink.Bus()
  validWpNum_u8: uint8  % 有效航点数量
  missionRoute_struct: Bus: wayPointBus[30 1]  % 航线

WP_TYPE = enum(DefaultValue="INVALID_WP")
  INVALID_WP = 0  % 无效航点
  MC_TAKEOFF_WP = 1  % 垂直起飞航点
  MC_LAND_WP = 2  % 垂直降落航点
  MC_LINE_WP = 3  % 旋翼直线航点
  FW_LINE_WP = 4  % 固定翼直线航点
  FW_CIR_WP = 5  % 圆弧航点

setPointBus = Simulink.Bus()
  lat_deg_d: double  % 纬度
  lon_deg_d: double  % 经度
  alt_m_f: single  % 高度
  yaw_deg_f: single  % 航向角

perfParamBus = Simulink.Bus()
  maxVx_mps_f: single  % 前向速度最大值
  minVx_mps_f: single  % 前向速度最小值
  maxVy_mps_f: single  % 侧向速度最大值
  minVy_mps_f: single  % 侧向速度最小值
  maxVz_mps_f: single  % 垂向速度最大值
  minVz_mps_f: single  % 垂向速度最小值
  maxAx_mps2_f: single  % 前向加速度最大值
  minAx_mps2_f: single  % 前向加速度最小值
  maxAy_mps2_f: single  % 侧向加速度最大值
  minAy_mps2_f: single  % 侧向加速度最小值
  maxAz_mps2_f: single  % 垂向加速度最大值
  minAz_mps2_f: single  % 垂向加速度最小值
  maxRollAngle_deg_f: single  % 滚转角最大值
  minRollAngle_deg_f: single  % 滚转角最小值
  maxPitchAngle_deg_f: single  % 俯仰角最大值
  minPitchAngle_deg_f: single  % 俯仰角最小值
  maxRollAngleRate_dps_f: single  % 滚转角速度最大值
  minRollAngleRate_dps_f: single  % 滚转角速度最小值
  maxPitchAngleRate_dps_f: single  % 俯仰角速度最大值
  minPitchAngleRate_dps_f: single  % 俯仰角速度最小值
  maxYawAngleRate_dps_f: single  % 偏航角速度最大值
  minYawAngleRate_dps_f: single  % 偏航角速度最小值